# Grasshopper definition gear example.gh (Grasshopper 1.0.7)
# plug-ins: Gear, Weaverbird

number_slider = Slider(20, range=0..100)
number_slider_2 = Slider(12, range=0..100)
number_slider_3 = Slider(16, range=0..100)
neg = Negative(Value=number_slider)
addition = Addition(A="150", B=number_slider)
addition_2 = Addition(A="200", B=number_slider_3, C=number_slider_2)
number_slider_4 = Slider(34, range=0..50)
pt = ConstructPoint(XCoordinate=addition, YCoordinate=neg, ZCoordinate=0)
pt_2 = ConstructPoint(XCoordinate="150", YCoordinate=0, ZCoordinate=0)
Y = UnitY(Factor=1)
pt_3 = Point([Point(8.27830045, 0.1876384051, 19.8391386), Point(0.0826773557, 0.1876384051, 0), Point(27.45491687, 0.1573205954, 0)])
pt_4 = Point(Point(66.94211039, -0.3415213766, 0))
pt_5 = ConstructPoint(XCoordinate=addition_2, YCoordinate=0, ZCoordinate=0)
pline = PolyLine(Vertices=pt_3, Closed=False)
crv = Curve([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])
cir = Circle(Plane=pt_4, Radius=Slider(19, range=0..100))
line = LineSDL(Start=pt, Direction=Y, Length=Slider(43, range=0..100))
cir_2 = Circle(Plane=["200,0,0", pt_5], Radius=[number_slider_3, number_slider_2])
spurg = SpurGear(Circles=crv, Teeth=Slider(12, range=0..100), Angle=22.5, Shift=0.1, Addendum=1, Dedendum=1.25)  # -> Gears, Pitch, Ratio
axepitch = Axe2Pitch(Axe=pline, Radius=Slider(15.2, range=0..100))  # -> PitchCircle, AxePolyline
anglepitch = Angle2Pitch(Circle=cir, Radius=Slider(24, range=0..100), Angle=Slider(0, range=-90..90), Location=Slider(0, range=0..360))  # -> PitchCircle, AxePolyline
number_slider_5 = Slider(54, range=0..70)

expression = Expression(r=number_slider, t=number_slider_4, Expression="2*r/t")
cir_3 = Circle(Plane=pt_2, Radius=number_slider)

number_slider_6 = Slider(13, range=0..100)
spurg_2 = SpurGear(Circles=cir_2, Teeth=Slider(26, range=0..50), Angle=22.5, Shift=0.1, Addendum=1, Dedendum=1.25)  # -> Gears, Pitch, Ratio
panel = Panel(spurg.Gears)
panel_2 = Panel(spurg.Ratio)
panel_3 = Panel(spurg.Pitch)
helicalg = HelicalGear(Gear=spurg_2.Gears, Pitch=spurg_2.Pitch, Angle=Slider(42, range=0..70), Heigh=Slider(13, range=0..100), Solid=False)
rack = Rack(Line=line, CircleModule=cir_3, Teeth=number_slider_4, Angle=22.5, Addendum=1, Dedendum=1.25)
spurg_3 = SpurGear(Circles=cir_3, Teeth=number_slider_4, Angle=22.5, Shift=0.1, Addendum=1, Dedendum=1.25)  # -> Gears, Pitch, Ratio
bevelg = BevelGear(
    Circle=anglepitch.PitchCircle,
    Polyline=anglepitch.AxePolyline,
    Teeth=Slider(25, range=0..100),
    Depth=Slider(13, range=0..100),
    HoleSize=[Slider(2, range=0..10), Slider(2, range=0..10)],
    Angle=22.5,
    Shift=0.1,
    Addendum=0.95,
    Dedendum=1.25,
    Option=Toggle(False))  # -> Gears, Pitch, Ratio
bevelg_2 = BevelGear(
    Circle=axepitch.PitchCircle,
    Polyline=axepitch.AxePolyline,
    Teeth=Slider(35, range=0..100),
    Depth=Slider(2, range=0..100),
    HoleSize=[Slider(2, range=0..10), Slider(2, range=0..10)],
    Angle=22.5,
    Shift=0.1,
    Addendum=0.95,
    Dedendum=1.25,
    Option=Toggle(True))  # -> Gears, Pitch, Ratio
wbvertices = WeaverbirdsVerticesComponent(MeshClosedPolylinesGroup=bevelg_2.Gears, Weld=True)
panel_4 = Panel(bevelg_2.Gears)
helicalr = HelicalRack(
    Line=line,
    CircleModule=cir_3,
    Teeth=number_slider_4,
    Angle=22.5,
    HelicalAngle=number_slider_5,
    Depth=number_slider_6,
    Addendum=1,
    Dedendum=1.25)
helicalg_2 = HelicalGear(Gear=spurg_3.Gears, Pitch=spurg_3.Pitch, Angle=number_slider_5, Heigh=number_slider_6, Solid=False)
item = ListItem(List=wbvertices, Index=0, Wrap=True)  # -> Item, Item1
